# Dynamo graph Excel_IO-211020.dyn (Dynamo 2.10.0.3455)

string = StringInput("F:\_NGHIEN CUU\_Github\py_dynamo_revit\excel_IO\Book1.xlsx")
string_2 = StringInput("Sheet1")
python_script = Python(IN[0]=string, IN[1]=string_2)  # IronPython2
# ---------- python_script.python (24 lines) ----------
import clr
clr.AddReference("Microsoft.Office.Interop.Excel")
from System.Runtime.InteropServices import Marshal
import Microsoft.Office.Interop.Excel as Excel
excel = Excel.ApplicationClass()
excel.Visible = True 

# makes the Excel application visible to the user 

#workbook = excel.Workbooks.Add() # Add new work book
#worksheet = workbook.Worksheets.Add() # Add new work sheet
excel_path = IN[0]
sheet_name = IN[1]
workbook = excel.Workbooks.Open(excel_path)

worksheets = workbook.Worksheets

sheet = [worksheets(i+1) for i in range(worksheets.Count) if worksheets(i+1).Name == sheet_name][0]

row = 7
col = 2


OUT = [sheet.Cells(i,col).Text for i in range(row)]
# ----------------------------------------
watch = Watch(python_script)
exportExcel = Data.ExportExcel()  # unwired: filePath, sheetName, startRow, startCol, data
importExcel = Data.ImportExcel()  # unwired: file, sheetName
